% Requirement links of test_Req_FuelEndurance_01.m (R2026a)

% lines 8-13 verifies ShipRequirements.slreqx##134
testCase.assertFalse(isnan(perfValThreshold), 'PerfVal1 attribute could not be read from requirement link.');

% 2. Get system endurance from model
actualSystemDays = getFuelSystemEndurance('SYSTEM');

% 3. Verify requirement condition