% Requirement links of test_Req_FuelEndurance_02.m (R2026a)

% lines 10-14 verifies ShipRequirements.slreqx#135

testCase.verifyGreaterThanOrEqual(actualSystemDays, perfValThreshold, ...
    sprintf('Requirement FAILED: System endurance (%.2f days) is below required threshold (%.2f days).', ...
    actualSystemDays, perfValThreshold));
end