% Requirement links of test_cooling.m (R2026a)

% lines 5-16 verifies ShipRequirements.slreqx#11
function test_CoolingSupplyVersusDemand(testCase)
% 1. Define values

[coolReq, ~] =sumPropIfOn('CoolConsumed', 'CoolConsumer', 'CoolingProfile');
[coolGen, ~] =sumPropIfOn('CoolProduced', 'CoolProducer', 'CoolingProfile');


% 2. Use the test framework assertion
verifyGreaterThanOrEqual(testCase, coolGen, coolReq, ...
    'Insufficient Cooling Supply');

end